# Grasshopper definition SetParametersFromExcel_02.gh (Grasshopper 1.0.7)
# Copyright: Arup
# plug-ins: LunchBox

panel = Panel("C:\Users\giovanni.brogiolo\Desktop\WPA\Model Production Delivery Table (MPDT).xlsx")
excel_reader = ExcelReader(ReadExcelData=Toggle(True), WorkbookPath=panel, WorksheetName="Test")  # -> Exceptions, ExcelData
panel_2 = Panel(excel_reader.ExcelData)

# ---- group: Find Mapping Column in Excel (Package Specific Description)
column_name = Panel("Package Specific Description ")
cull_index = CullIndex(List=excel_reader.ExcelData, Indices="0", Wrap=True)  # -> simplify(List)

# ---- group: Find Mapping Column in Excel (Package Specific Description) / Find Column Branch
ghpython_script = GhPythonScript(ExcelData=excel_reader.ExcelData, Text=column_name)  # -> out, a; inputs ExcelData: tree
# ---------- ghpython_script: Python ----------
import ghpythonlib.treehelpers as th


#ExcelData = th.tree_to_list(ExcelData)

#a = ExcelData[0].index(Text)
x = ExcelData
result = []

for i in range(x.BranchCount):
    branchList = x.Branch(i)
    result.append(branchList[0])
    #for j in range(branchList.Count):
    #    result.append(branchList[0])

a = result.index(Text)

#a = result

#a = x.Branch(0).Count
# ---------- end ghpython_script ----------

# ---- group: Find Mapping Column in Excel (Package Specific Description) (continued)
panel_3 = Panel(ghpython_script.a)
tree_branch = TreeBranch(Tree=cull_index, Path=panel_3, MaintainPaths=True)  # -> flatten(Branch)

# ----
list_item = ListItem(List=excel_reader.ExcelData, Index="0", Wrap=True)
cull_index_2 = CullIndex(List=flatten(list_item), Indices=panel_3, Wrap=True)  # -> flatten(List)
panel_4 = Panel(cull_index_2)

panel_5 = Panel(cull_index)
panel_6 = Panel(tree_branch)
ghpython_script_2 = GhPythonScript(x=panel_6)  # -> Elements, Indexes; inputs x: list
# ---------- ghpython_script_2: Python ----------
import clr
clr.AddReference('System.Core')
from System.Linq import Enumerable
from System.IO import Path, File

clr.AddReference('RhinoInside.Revit')
from Rhino.Geometry import *
from RhinoInside.Revit import Revit, Convert

clr.AddReference('RevitAPI')
from Autodesk.Revit.DB import *
from Autodesk.Revit.DB.Structure import *

clr.AddReference('System')
from System.Collections.Generic import List

clr.AddReference("RevitServices")
import RevitServices
from RevitServices.Persistence import DocumentManager
from RevitServices.Transactions import TransactionManager

import sys
sys.path.append(r'C:\Program Files (x86)\IronPython 2.7\Lib')
import os

doc = Revit.ActiveDBDocument
app = doc.Application

builtInCats = List[ElementId]()
indexes = []

for c in doc.Settings.Categories:
    if c.Name in x:
        builtInCats.Add(c.Id)

categoryFilter = ElementMulticategoryFilter(builtInCats);


ids = FilteredElementCollector(doc).WherePasses(categoryFilter).WhereElementIsNotElementType().ToElements();

for i in ids:
    indexes.append(x.IndexOf(i.Category.Name))

#a = "Walls" in x
Elements = ids
Indexes = indexes
# ---------- end ghpython_script_2 ----------
flip_matrix = FlipMatrix(Data=panel_5)
panel_7 = Panel(flip_matrix)
ghpython_script_3 = GhPythonScript(x=flip_matrix, Indexes=ghpython_script_2.Indexes)  # -> out, simplify(a); inputs x: tree, Indexes: list
# ---------- ghpython_script_3: Python ----------
import ghpythonlib.treehelpers as ght
import Grasshopper as gh

def list_to_tree(input, none_and_holes=True, source=[0]):
    """Transforms nestings of lists or tuples to a Grasshopper DataTree"""
    from Grasshopper import DataTree as Tree
    from Grasshopper.Kernel.Data import GH_Path as Path
    from System import Array
    def proc(input,tree,track):
        path = Path(Array[int](track))
        if len(input) == 0 and none_and_holes: tree.EnsurePath(path); return
        for i,item in enumerate(input):
            if hasattr(item, '__iter__'): #if list or tuple
                track.append(i); proc(item,tree,track); track.pop()
            else:
                if none_and_holes: tree.Insert(item,path,i)
                elif item is not None: tree.Add(item,path)
    if input is not None: t=Tree[object]();proc(input,t,source[:]);return t

pyList = [list(b) for b in x.Branches]

reorderList = []

for i in Indexes:
    reorderList.append(pyList[i])


a = list_to_tree(reorderList)
# ---------- end ghpython_script_3 ----------
panel_8 = Panel(ghpython_script_3.a)

# ---- group: Set Element Parameters
ghpython_script_4 = GhPythonScript(elements=ghpython_script_2.Elements, paramNames=panel_4, paramValues=ghpython_script_3.a)  # -> updated, errors, reports; inputs elements: list, paramNames: list, paramValues: tree
# ---------- ghpython_script_4: Python ----------
import clr
clr.AddReference('System.Core')
from System.Linq import Enumerable
from System.IO import Path, File

clr.AddReference('RhinoInside.Revit')
from Rhino.Geometry import *
from RhinoInside.Revit import Revit, Convert

clr.AddReference('RevitAPI')
from Autodesk.Revit.DB import *
from Autodesk.Revit.DB.Structure import *

clr.AddReference('System')
from System.Collections.Generic import List

clr.AddReference("RevitServices")
import RevitServices
from RevitServices.Persistence import DocumentManager
from RevitServices.Transactions import TransactionManager

def list_to_tree(input, none_and_holes=True, source=[0]):
    """Transforms nestings of lists or tuples to a Grasshopper DataTree"""
    from Grasshopper import DataTree as Tree
    from Grasshopper.Kernel.Data import GH_Path as Path
    from System import Array
    def proc(input,tree,track):
        path = Path(Array[int](track))
        if len(input) == 0 and none_and_holes: tree.EnsurePath(path); return
        for i,item in enumerate(input):
            if hasattr(item, '__iter__'): #if list or tuple
                track.append(i); proc(item,tree,track); track.pop()
            else:
                if none_and_holes: tree.Insert(item,path,i)
                elif item is not None: tree.Add(item,path)
    if input is not None: t=Tree[object]();proc(input,t,source[:]);return t

doc = Revit.ActiveDBDocument
app = doc.Application

#inputs
listParamValues = [list(b) for b in paramValues.Branches]

#outputs
done = 0
error = []
report = []

with Transaction(doc, "Set Parameters") as trans:
    trans.Start()
    for e,p in zip(elements, listParamValues):
        try:
            for i in range(len(paramNames)):
                try:
                    param = e.LookupParameter(paramNames[i])
                    param.Set(p[i])
                except:
                    continue
            done += 1
        except:
            import traceback
            error.append(e.Id)
            report.append(traceback.format_exc())
    trans.Commit()

updated = done
errors = error
reports = report
# ---------- end ghpython_script_4 ----------

# ----
panel_9 = Panel(ghpython_script_4.errors)
panel_10 = Panel(ghpython_script_4.updated)
panel_11 = Panel(ghpython_script_4.reports)
