# Dynamo graph SetStationParameters_01.dyn (Dynamo 2.2.0.4667)

# group: Almost all model elements
python_script = Python()  # unwired: IN[0]
# ---------- python_script.python (35 lines) ----------
import clr

clr.AddReference('RevitAPI')
from Autodesk.Revit.DB import *
from Autodesk.Revit.DB.Structure import *

clr.AddReference('RevitAPIUI')
from Autodesk.Revit.UI import *

clr.AddReference('System')
from System.Collections.Generic import List

clr.AddReference('RevitNodes')
import Revit
clr.ImportExtensions(Revit.GeometryConversion)
clr.ImportExtensions(Revit.Elements)

clr.AddReference('RevitServices')
import RevitServices
from RevitServices.Persistence import DocumentManager
from RevitServices.Transactions import TransactionManager

doc = DocumentManager.Instance.CurrentDBDocument
uidoc=DocumentManager.Instance.CurrentUIApplication.ActiveUIDocument

fec = FilteredElementCollector(doc).WhereElementIsNotElementType()

result = []

for f in fec:
	if f.Category != None and f.Category.CategoryType == CategoryType.Model and f.Category.HasMaterialQuantities == True:
		result.append(f)


OUT = result
# ----------------------------------------

# group: Railings
python_script_2 = Python()  # unwired: IN[0]
# ---------- python_script_2.python (35 lines) ----------
import clr

clr.AddReference('RevitAPI')
from Autodesk.Revit.DB import *
from Autodesk.Revit.DB.Structure import *

clr.AddReference('RevitAPIUI')
from Autodesk.Revit.UI import *

clr.AddReference('System')
from System.Collections.Generic import List

clr.AddReference('RevitNodes')
import Revit
clr.ImportExtensions(Revit.GeometryConversion)
clr.ImportExtensions(Revit.Elements)

clr.AddReference('RevitServices')
import RevitServices
from RevitServices.Persistence import DocumentManager
from RevitServices.Transactions import TransactionManager

doc = DocumentManager.Instance.CurrentDBDocument
uidoc=DocumentManager.Instance.CurrentUIApplication.ActiveUIDocument

fecRailings = FilteredElementCollector(doc).OfCategory(BuiltInCategory.OST_Railings).WhereElementIsNotElementType()

fecStairRailings = FilteredElementCollector(doc).OfCategory(BuiltInCategory.OST_StairsRailing).WhereElementIsNotElementType()

result = []

railings = [f for f in fecRailings]
stairRailings = [r for r in fecStairRailings]

OUT = railings + stairRailings
# ----------------------------------------

join = List.Join(list0=python_script, list1=python_script_2)

# group: Parameters
code_block = CodeBlock()
# ---------- code_block.designscript (10 lines) ----------
["Model Name",
"Element Author",
"Element Discipline",
"Element Status",
"Element Suitability",
"Design Package Number",
"Element LOD",
"Is Constructed",
"SBS-ID",
"Handover Lot No"];
# ----------------------------------------

# group: Values
code_block_2 = CodeBlock()
# ---------- code_block_2.designscript (10 lines) ----------
["WSP-014-C-WPA-MOD-31-WER-ARC-3100.rvt",
"DJV",
"Architecture",
"Proposed",
"Issued for information",
"DP-31-01 (illustrated below) DP-31-02 (illustrated below)",
"200",
"No",
"",
""];
# ----------------------------------------

python_script_3 = Python(IN[0]=join, IN[1]=code_block, IN[2]=code_block_2)
# ---------- python_script_3.python (54 lines) ----------
import clr

clr.AddReference('RevitAPI')
from Autodesk.Revit.DB import *
from Autodesk.Revit.DB.Structure import *

clr.AddReference('RevitAPIUI')
from Autodesk.Revit.UI import *

clr.AddReference('System')
from System.Collections.Generic import List

clr.AddReference('RevitNodes')
import Revit
clr.ImportExtensions(Revit.GeometryConversion)
clr.ImportExtensions(Revit.Elements)

clr.AddReference('RevitServices')
import RevitServices
from RevitServices.Persistence import DocumentManager
from RevitServices.Transactions import TransactionManager



doc = DocumentManager.Instance.CurrentDBDocument
uidoc=DocumentManager.Instance.CurrentUIApplication.ActiveUIDocument

#Preparing input from dynamo to revit
element = UnwrapElement(IN[0])

paramNames = IN[1]
paramValues = IN[2]

done = 0
error = 0
report = ""
#Do some action in a Transaction
TransactionManager.Instance.EnsureInTransaction(doc)

for e in element:
	for name,value in zip(paramNames, paramValues):
		try:
			param = e.LookupParameter(name)
			param.Set(value)
			done += 1
		except:
			error += 1
			import traceback
			report = traceback.format_exc()


TransactionManager.Instance.TransactionTaskDone()

OUT = ["done", done], ["error", error], report
# ----------------------------------------
